# Grasshopper definition Arcade Facades Procedural Modeling.gh (Grasshopper 1.0.7)
# plug-ins: Bifocals

parapet_type = Slider(1, range=0..2)
width = Slider(4.5, range=0..10)
column_width = Slider(0.3, range=0..1)
height = Slider(14, range=0..100)

# ---- group: 请输入基准点
point = Point(Point(0, 0, 0))

# ----
unit_x = UnitX(Factor=width)
unit_x_2 = UnitX(Factor=column_width)
unit_z = UnitZ(Factor=height)

# ---- group: Straight Parapet
parapet_height = Slider(1.88, range=0..10)
point_2 = Point(point)
move = Move(Geometry=point_2, Motion=unit_z)  # -> Geometry, Transform
unit_z_2 = UnitZ(Factor=parapet_height)
xz_plane = XZPlane(Origin=move.Geometry)
rectangle = Rectangle(Plane=xz_plane, XSize=unit_x, YSize=unit_z_2, Radius=0)  # -> Rectangle, Length

# ----
xz_plane_2 = XZPlane(Origin=point)
move_2 = Move(Geometry=point, Motion=unit_x)  # -> Geometry, Transform
subtraction = Subtraction(A=unit_x, B=unit_x_2)
line = Line(StartPoint=point, EndPoint=move_2.Geometry)

# ---- group: pillar
rectangle_2 = Rectangle(Plane=xz_plane_2, XSize=unit_x_2, YSize=unit_z, Radius=0)  # -> Rectangle, Length
move_3 = Move(Geometry=rectangle_2.Rectangle, Motion=subtraction)  # -> Geometry, Transform

# ---- group: 1F Beam-column connection
h1 = Slider(4.53, range=0..10)
beam_width = Slider(0.58, range=0..1)
curve_middle = CurveMiddle(Curve=line)
unit_z_3 = UnitZ(Factor=h1)
move_4 = Move(Geometry=curve_middle, Motion=unit_z_3)  # -> Geometry, Transform
division = Division(A=width, B="2")
xz_plane_3 = XZPlane(Origin=move_4.Geometry)
subtraction_2 = Subtraction(A=division, B=column_width)
construct_domain = ConstructDomain(DomainStart=expr("-x", subtraction_2), DomainEnd=subtraction_2)
rectangle_3 = Rectangle(Plane=xz_plane_3, XSize=construct_domain, YSize=beam_width, Radius=0)  # -> Rectangle, Length

# ---- group: 2F Beam
h2 = Slider(4.65, range=0..10)
beam_width_2 = Slider(0.2, range=0.1..1)
explode = Explode(Curve=rectangle_3.Rectangle, Recursive=True)  # -> Segments, Vertices
list_item = ListItem(List=explode.Segments, Index=0, Wrap=True)  # -> Item, Item1, Item2
unit_z_4 = UnitZ(Factor=h2)
move_5 = Move(Geometry=list_item.Item2, Motion=unit_z_4)  # -> Geometry, Transform
end_points = EndPoints(Curve=move_5.Geometry)  # -> Start, End
xz_plane_4 = XZPlane(Origin=end_points.End)
rectangle_4 = Rectangle(Plane=xz_plane_4, XSize=move_5.Geometry, YSize=beam_width_2, Radius=0)  # -> Rectangle, Length

# ---- group: Gate
h0 = Slider(3.43, range=0..5)
w1 = Slider(0.48, range=0..2)
curve_middle_2 = CurveMiddle(Curve=line)
length = Length(Curve=line)
xz_plane_5 = XZPlane(Origin=curve_middle_2)
division_2 = Division(A=length, B=2)
addition = Addition(A=column_width, B=w1)
subtraction_3 = Subtraction(A=division_2, B=addition)
construct_domain_2 = ConstructDomain(DomainStart=expr("-x", subtraction_3), DomainEnd=subtraction_3)
rectangle_5 = Rectangle(Plane=xz_plane_5, XSize=construct_domain_2, YSize=h0, Radius=0)  # -> Rectangle, Length

# ---- group: 3F Windows
windows_num = Slider(3, range=0..10)
window_height = Slider(2, range=0.5..3)
window_height_2 = Slider(1.3, range=0..2)
window_width = Slider(1.1, range=0..10)
sash_width = Slider(0.1, range=0..1)

explode_2 = Explode(Curve=rectangle_4.Rectangle, Recursive=True)  # -> Segments, Vertices
w3 = Slider(0.1, range=0.01..0.5)
door_list = Slider(1, range=0..10)
door = BooleanToggle(True)
list_item_2 = ListItem(List=explode_2.Segments, Index=0, Wrap=True)  # -> Item, Item1, Item2
unit_z_5 = UnitZ(Factor=window_height_2)
line_2 = Line(list_item_2.Item2)
multiplication = Multiplication(A=column_width, B=2)
subtraction_4 = Subtraction(A=width, B=multiplication)
move_6 = Move(Geometry=line_2, Motion=unit_z_5)  # -> Geometry, Transform
multiplication_2 = Multiplication(A=sash_width, B=2)
flip_curve = FlipCurve(Curve=move_6.Geometry)  # -> Curve, Flag
subtraction_5 = Subtraction(A=subtraction_4, B=multiplication_2)
division_3 = Division(A=subtraction_5, B=windows_num)
smaller_than = SmallerThan(FirstNumber=window_width, SecondNumber=division_3)  # -> SmallerThan, OrEqualTo
end_points_2 = EndPoints(Curve=flip_curve.Curve)  # -> Start, End
stream_filter = StreamFilter(Gate=smaller_than.OrEqualTo, Stream0=division_3, Stream1=window_width)
addition_2 = Addition(A=stream_filter, B=w3)
amplitude = Amplitude(Vector=flip_curve.Curve, Amplitude=w3)
amplitude_2 = Amplitude(Vector=move_6.Geometry, Amplitude=addition_2)
move_7 = Move(Geometry=end_points_2.Start, Motion=amplitude)  # -> Geometry, Transform
xz_plane_6 = XZPlane(Origin=move_7.Geometry)
rectangle_6 = Rectangle(Plane=xz_plane_6, XSize=stream_filter, YSize=window_height, Radius=0)  # -> Rectangle, Length
move_8 = Move(Geometry=end_points_2.End, Motion=amplitude_2)  # -> Geometry, Transform
line_3 = Line(StartPoint=move_7.Geometry, EndPoint=move_8.Geometry)
curve_array = CurveArray(Geometry=rectangle_6.Rectangle, Curve=line_3, Count=windows_num)  # -> Geometry, Transform
area = Area(Geometry=curve_array.Geometry)  # -> Area, Centroid
stream_gate = StreamGate(Stream=curve_array.Geometry, Gate=door)  # -> Target0, Target1
list_item_3 = ListItem(List=stream_gate.Target1, Index=door_list, Wrap=True)
xz_plane_7 = XZPlane(Origin=area.Centroid)
explode_3 = Explode(Curve=list_item_3, Recursive=True)  # -> Segments, Vertices
stream_filter_2 = StreamFilter(Gate=door, Stream0=curve_array.Geometry, Stream1=list_item_3)
cull_index = CullIndex(List=curve_array.Geometry, Indices=door_list, Wrap=True)
list_item_4 = ListItem(List=explode_3.Segments, Index=0, Wrap=True)  # -> Item, Item1, Item2
stream_gate_2 = StreamGate(Stream=cull_index, Gate=door)  # -> Target0, Target1
stream_gate_3 = StreamGate(Stream=stream_filter_2, Gate=door)  # -> Target0, Target1
curve_middle_3 = CurveMiddle(Curve=list_item_4.Item)
end_points_3 = EndPoints(Curve=list_item_4.Item2)  # -> Start, End
offset_curve = OffsetCurve(Curve=[stream_gate_2.Target1, stream_gate_3.Target0], Distance=expr("-x", sash_width), Plane=xz_plane_7, Corners=1)
stream_filter_3 = StreamFilter(Gate=door, Stream0=curve_array.Geometry, Stream1=cull_index)
pull_point = PullPoint(Point=curve_middle_3, Geometry=rectangle_4.Rectangle, ClosestOnly=True)  # -> ClosestPoint, Distance
rectangle_3pt = Rectangle3Pt(PointA=end_points_3.Start, PointB=end_points_3.End, PointC=pull_point.ClosestPoint)  # -> Rectangle, Length
merge = Merge(Data1=offset_curve, Data2=stream_filter_3)

# ---- group: 3F Balcony
explode_4 = Explode(Curve=rectangle_4.Rectangle, Recursive=True)  # -> Segments, Vertices
_3f_baclcony = BooleanToggle(True)
balcony_width = Slider(3.54, range=0..10)
balcony_height = Slider(1.07, range=0..1.5)
list_item_5 = ListItem(List=explode_4.Segments, Index=0, Wrap=True)  # -> Item, Item1, Item2
number = Number(width)
multiplication_3 = Multiplication(A=column_width, B=2)
curve = Curve(list_item_5.Item2)
subtraction_6 = Subtraction(A=number, Result=multiplication_3)
curve_middle_4 = CurveMiddle(Curve=curve)
ghpython_script = GhPythonScript(x=balcony_width, y=subtraction_6, z=subtraction_6)  # -> out, a
# ---------- ghpython_script: Python ----------
__author__ = "12100"
__version__ = "2023.08.09"

import rhinoscriptsyntax as rs

# 输入值和阈值
input_value = x  # 这里的 x 代表输入值，需要在组件中设置输入
threshold = y    # 这里的 y 代表阈值，需要在组件中设置输入
fixed_value = z  # 这里的 z 代表固定输出值，需要在组件中设置输入

# 判断条件
if input_value < threshold:
    output_value = input_value
else:
    output_value = fixed_value

# 输出结果
a = output_value/2  # 将输出值赋值给 a，该变量将在组件的输出中显示
# ---------- end ghpython_script ----------
construct_domain_3 = ConstructDomain(DomainStart=expr("-x", ghpython_script.a), DomainEnd=ghpython_script.a)
unit_z_6 = UnitZ(Factor=balcony_height)
xz_plane_8 = XZPlane(Origin=curve_middle_4)
rectangle_7 = Rectangle(Plane=xz_plane_8, XSize=construct_domain_3, YSize=unit_z_6, Radius=0)  # -> Rectangle, Length
stream_filter_4 = StreamFilter(Gate=_3f_baclcony, Stream1=rectangle_7.Rectangle)
curve_2 = Curve(rectangle_3pt.Rectangle)
region_difference = RegionDifference(CurvesA=curve_2, CurvesB=stream_filter_4)

# ----
stream_filter_5 = StreamFilter(Gate=_3f_baclcony, Stream0=rectangle_3pt.Rectangle, Stream1=region_difference)

# ---- group: Undulating parapet
undulating_width = Slider(0.2, range=0.1..1.1)
explode_5 = Explode(Curve=rectangle.Rectangle, Recursive=True)  # -> Segments, Vertices
list_item_6 = ListItem(List=explode_5.Segments, Index=0, Wrap=True)  # -> Item, Item1, Item2, Item3
subtraction_7 = Subtraction(A="1", B=undulating_width)
curve_3 = Curve(list_item_6.Item3)
curve_4 = Curve(list_item_6.Item1)
curve_5 = Curve(list_item_6.Item)
evaluate_curve = EvaluateCurve(Curve=reparameterize(curve_5), Parameter=undulating_width)  # -> Point, Tangent, Angle
evaluate_curve_2 = EvaluateCurve(Curve=reparameterize(curve_5), Parameter=subtraction_7)  # -> Point, Tangent, Angle
pull_point_2 = PullPoint(Point=[evaluate_curve_2.Point, evaluate_curve.Point], Geometry=list_item_6.Item2, ClosestOnly=True)  # -> ClosestPoint, Distance
curve_6 = Curve(rectangle.Rectangle)

# ---- group: Undulating parapet / Undulating Height
point_on_curve = PointOnCurve(curve_3, parameter=0.241)

# ---- group: Undulating parapet (continued)
pull_point_3 = PullPoint(Point=point_on_curve, Geometry=curve_4, ClosestOnly=True)  # -> ClosestPoint, Distance
line_4 = Line(StartPoint=point_on_curve, EndPoint=pull_point_3.ClosestPoint)
pull_point_4 = PullPoint(Point=[evaluate_curve_2.Point, evaluate_curve.Point], Geometry=line_4, ClosestOnly=True)  # -> ClosestPoint, Distance
explode_6 = Explode(Curve=line_4, Recursive=True)  # -> Segments, Vertices
point_3 = Point(reverse(explode_6.Vertices))
rectangle_3pt_2 = Rectangle3Pt(PointA=pull_point_2.ClosestPoint, PointB=pull_point_4.ClosestPoint, PointC=point_3)  # -> Rectangle, Length
region_difference_2 = RegionDifference(CurvesA=curve_6, CurvesB=rectangle_3pt_2.Rectangle)

# ---- group: Perforated Parapet
area_2 = Area(Geometry=region_difference_2)  # -> Area, Centroid
perforated_radius = Slider(0.3, range=0..1)
xz_plane_9 = XZPlane(Origin=area_2.Centroid)
circle = Circle(Plane=xz_plane_9, Radius=perforated_radius)
merge_2 = Merge(Data1=region_difference_2, Data2=circle)

# ----
stream_filter_6 = StreamFilter(Gate=parapet_type, Stream0=rectangle.Rectangle, Stream1=region_difference_2, Stream2=merge_2)

# ---- group: 2F Windows
line_5 = Line(list_item.Item2)
windows_num_2 = Slider(3, range=0..10)
windows_height = Slider(1.7, range=0..2)
w2 = Slider(0.12, range=0.01..0.5)
windows_width = Slider(1.1, range=0..10)
windows_lenght = Slider(2, range=0.5..3)
sash_width_2 = Slider(0.1, range=0..1)
door_list_2 = Slider(1, range=0..10)
unit_z_7 = UnitZ(Factor=windows_height)
door_2 = BooleanToggle(True)
move_9 = Move(Geometry=line_5, Motion=unit_z_7)  # -> Geometry, Transform
multiplication_4 = Multiplication(A=column_width, B=2)
subtraction_8 = Subtraction(A=width, B=multiplication_4)
multiplication_5 = Multiplication(A=sash_width_2, B=2)
subtraction_9 = Subtraction(A=subtraction_8, B=multiplication_5)
flip_curve_2 = FlipCurve(Curve=move_9.Geometry)  # -> Curve, Flag
division_4 = Division(A=subtraction_9, B=windows_num_2)
end_points_4 = EndPoints(Curve=flip_curve_2.Curve)  # -> Start, End
amplitude_3 = Amplitude(Vector=flip_curve_2.Curve, Amplitude=w2)
move_10 = Move(Geometry=end_points_4.Start, Motion=amplitude_3)  # -> Geometry, Transform
xz_plane_10 = XZPlane(Origin=move_10.Geometry)

# ----
smaller_than_2 = SmallerThan(FirstNumber=windows_width, SecondNumber=division_4)  # -> SmallerThan, OrEqualTo

# ---- group: 2F Windows (continued)
stream_filter_7 = StreamFilter(Gate=smaller_than_2.OrEqualTo, Stream0=division_4, Stream1=windows_width)
addition_3 = Addition(A=stream_filter_7, B=w2)
amplitude_4 = Amplitude(Vector=move_9.Geometry, Amplitude=addition_3)
move_11 = Move(Geometry=end_points_4.End, Motion=amplitude_4)  # -> Geometry, Transform
rectangle_8 = Rectangle(Plane=xz_plane_10, XSize=stream_filter_7, YSize=windows_lenght, Radius=0)  # -> Rectangle, Length
line_6 = Line(StartPoint=move_10.Geometry, EndPoint=move_11.Geometry)
curve_array_2 = CurveArray(Geometry=rectangle_8.Rectangle, Curve=line_6, Count=windows_num_2)  # -> Geometry, Transform
area_3 = Area(Geometry=curve_array_2.Geometry)  # -> Area, Centroid
stream_gate_4 = StreamGate(Stream=curve_array_2.Geometry, Gate=door_2)  # -> Target0, Target1
list_item_7 = ListItem(List=stream_gate_4.Target1, Index=door_list_2, Wrap=True)
xz_plane_11 = XZPlane(Origin=area_3.Centroid)
explode_7 = Explode(Curve=list_item_7, Recursive=True)  # -> Segments, Vertices
cull_index_2 = CullIndex(List=curve_array_2.Geometry, Indices=door_list_2, Wrap=True)
stream_filter_8 = StreamFilter(Gate=door_2, Stream0=curve_array_2.Geometry, Stream1=list_item_7)
list_item_8 = ListItem(List=explode_7.Segments, Index=0, Wrap=True)  # -> Item, Item1, Item2
stream_gate_5 = StreamGate(Stream=stream_filter_8, Gate=door_2)  # -> Target0, Target1
stream_gate_6 = StreamGate(Stream=cull_index_2, Gate=door_2)  # -> Target0, Target1
curve_middle_5 = CurveMiddle(Curve=list_item_8.Item)
end_points_5 = EndPoints(Curve=list_item_8.Item2)  # -> Start, End
offset_curve_2 = OffsetCurve(Curve=[stream_gate_6.Target1, stream_gate_5.Target0], Distance=expr("-x", sash_width_2), Plane=xz_plane_11, Corners=1)
stream_filter_9 = StreamFilter(Gate=door_2, Stream0=curve_array_2.Geometry, Stream1=cull_index_2)
pull_point_5 = PullPoint(Point=curve_middle_5, Geometry=rectangle_3.Rectangle, ClosestOnly=True)  # -> ClosestPoint, Distance
merge_3 = Merge(Data1=offset_curve_2, Data2=stream_filter_9)
rectangle_3pt_3 = Rectangle3Pt(PointA=end_points_5.Start, PointB=end_points_5.End, PointC=pull_point_5.ClosestPoint)  # -> Rectangle, Length

# ---- group: 2F Balcony
_2f_baclcony = BooleanToggle(True)
balcony_width_2 = Slider(3.61, range=0..10)
balcony_height_2 = Slider(1.21, range=0..1.5)
number_2 = Number(width)
multiplication_6 = Multiplication(A=column_width, B=2)
curve_7 = Curve(list_item.Item2)
subtraction_10 = Subtraction(A=number_2, Result=multiplication_6)
curve_middle_6 = CurveMiddle(Curve=curve_7)
ghpython_script_2 = GhPythonScript(x=balcony_width_2, y=subtraction_10, z=subtraction_10)  # -> out, a; same code as ghpython_script
construct_domain_4 = ConstructDomain(DomainStart=expr("-x", ghpython_script_2.a), DomainEnd=ghpython_script_2.a)
unit_z_8 = UnitZ(Factor=balcony_height_2)
xz_plane_12 = XZPlane(Origin=curve_middle_6)
rectangle_9 = Rectangle(Plane=xz_plane_12, XSize=construct_domain_4, YSize=unit_z_8, Radius=0)  # -> Rectangle, Length
stream_filter_10 = StreamFilter(Gate=_2f_baclcony, Stream1=rectangle_9.Rectangle)
curve_8 = Curve(rectangle_3pt_3.Rectangle)
region_difference_3 = RegionDifference(CurvesA=curve_8, CurvesB=stream_filter_10)

# ----
stream_filter_11 = StreamFilter(Gate=_2f_baclcony, Stream0=rectangle_3pt_3.Rectangle, Stream1=region_difference_3)
merge_4 = Merge(
    Data1=line,
    Data2=rectangle_2.Rectangle,
    Data3=move_3.Geometry,
    Data4=rectangle_5.Rectangle,
    Data5=rectangle_3.Rectangle,
    Data6=stream_filter_10,
    Data7=merge_3,
    Data8=stream_filter_11,
    Data9=rectangle_4.Rectangle,
    Data10=stream_filter_4,
    Data11=merge,
    Data12=stream_filter_5,
    Data13=stream_filter_6)
